# Grasshopper definition Building_Hops.gh (Grasshopper 1.0.7)

floor_thickness = GetNumber(Slider(0.3, range=0.1..0.3), AtLeast=1, AtMost=1, Maximum=1.797693135e+308, Minimum=-1.797693135e+308, TreeAccess=False)
room_height = GetNumber(Slider(3, range=2.5..3), AtLeast=1, AtMost=1, Maximum=1.797693135e+308, Minimum=-1.797693135e+308, TreeAccess=False)
no_of_floors = GetInteger(Slider(8, range=1..20), AtLeast=1, AtMost=1, Maximum=2147483647, Minimum=-2147483648, TreeAccess=False)
length = GetInteger(Slider(13, range=5..25), AtLeast=1, AtMost=1, Maximum=2147483647, Minimum=-2147483648, TreeAccess=False)
width = GetInteger(Slider(15, range=5..25), AtLeast=1, AtMost=1, Maximum=2147483647, Minimum=-2147483648, TreeAccess=False)
xy_plane = XYPlane(Origin=Point(0, 0, 0))
yz_plane = YZPlane(Origin=Point(0, 0, 0))
rectangle = Rectangle(Plane=xy_plane, XSize=length, YSize=width, Radius=0)  # -> Rectangle, Length
series = Series(Start=0, Step=room_height, Count=no_of_floors)
series_2 = Series(Start=0, Step=room_height, Count=expr("x-1", no_of_floors))
rectangle_2 = Rectangle(Plane=yz_plane, XSize=width, YSize=room_height, Radius=0)  # -> Rectangle, Length
surface = Surface(rectangle.Rectangle)
unit_z = UnitZ(Factor=series)
surface_2 = Surface(rectangle_2.Rectangle)
unit_z_2 = UnitZ(Factor=series_2)
move = Move(Geometry=surface, Motion=unit_z)  # -> Geometry, Transform
unit_z_3 = UnitZ(Factor=floor_thickness)
move_2 = Move(Geometry=surface_2, Motion=unit_z_2)  # -> Geometry, Transform
extrude = Extrude(Base=move.Geometry, Direction=unit_z_3)
geometry = Geometry([extrude, move_2.Geometry])
context_bake = ContextBake(Geometry=geometry)
